# Grasshopper definition Kibo-RPC enviroment for workshop.gh (Grasshopper 1.0.8)
# plug-ins: Pufferfish

# ----
# Oasis Zone 1
# Oasis Zone 2
# Oasis Zone 3
# Oasis Zone 4
# Keep in Zone 1
# Keep in Zone 2
number_slider = Slider(4.8, range=0..10)
pt = ConstructPoint(XCoordinate=Slider(10.5, range=0..100), YCoordinate=Slider(-9.6, range=-20..100), ZCoordinate=number_slider)
pt_2 = ConstructPoint(XCoordinate=Slider(9.5, range=0..100), YCoordinate=Slider(-10.5, range=-20..100), ZCoordinate=Slider(4.02, range=0..10))
pt_3 = ConstructPoint(XCoordinate=Slider(11.55, range=0..100), YCoordinate=Slider(-6, range=-20..100), ZCoordinate=Slider(5.57, range=0..10))
pt_4 = ConstructPoint(XCoordinate=Slider(10.3, range=0..100), YCoordinate=Slider(-10.2, range=-20..100), ZCoordinate=Slider(4.32, range=0..10))
pt_5 = ConstructPoint(
    XCoordinate=Slider(11.425, range=0..100),
    YCoordinate=Slider(-6.35, range=-20..100),
    ZCoordinate=Slider(5.445, range=0..10))
pt_6 = ConstructPoint(
    XCoordinate=Slider(10.925, range=0..100),
    YCoordinate=Slider(-7.4, range=-20..100),
    ZCoordinate=Slider(4.425, range=0..10))
pt_7 = ConstructPoint(
    XCoordinate=Slider(10.975, range=0..100),
    YCoordinate=Slider(-7.4, range=-20..100),
    ZCoordinate=Slider(5.445, range=0..10))
pt_8 = ConstructPoint(
    XCoordinate=Slider(10.425, range=0..100),
    YCoordinate=Slider(-8.45, range=-20..100),
    ZCoordinate=Slider(4.945, range=0..10))
pt_9 = ConstructPoint(
    XCoordinate=Slider(11.425, range=0..100),
    YCoordinate=Slider(-8.5, range=-20..100),
    ZCoordinate=Slider(5.445, range=0..10))
pt_10 = ConstructPoint(
    XCoordinate=Slider(10.925, range=0..100),
    YCoordinate=Slider(-9.5, range=-20..100),
    ZCoordinate=Slider(4.945, range=0..10))
pt_11 = ConstructPoint(
    XCoordinate=Slider(11.425, range=0..100),
    YCoordinate=Slider(-9.5, range=-20..100),
    ZCoordinate=Slider(4.945, range=0..10))
pt_12 = ConstructPoint(
    XCoordinate=Slider(10.425, range=0..100),
    YCoordinate=Slider(-10.2, range=-20..100),
    ZCoordinate=Slider(4.445, range=0..10))
box = Box2Pt(PointA=pt_2, PointB=pt, Plane=PlaneXY(0, 0, 0))
box_2 = Box2Pt(PointA=pt_4, PointB=pt_3, Plane=PlaneXY(0, 0, 0))
box_3 = Box2Pt(PointA=pt_6, PointB=pt_5, Plane=PlaneXY(0, 0, 0))
box_4 = Box2Pt(PointA=pt_8, PointB=pt_7, Plane=PlaneXY(0, 0, 0))
box_5 = Box2Pt(PointA=pt_10, PointB=pt_9, Plane=PlaneXY(0, 0, 0))
box_6 = Box2Pt(PointA=pt_12, PointB=pt_11, Plane=PlaneXY(0, 0, 0))
rgb = ColourRGB(Alpha=Slider(78, range=0..100), Red=0, Green=Slider(255, range=0..1000), Blue=0)
rgb_2 = ColourRGB(Alpha=Slider(54, range=0..100), Red=0, Green=Slider(255, range=0..1000), Blue=0)
rgb_3 = ColourRGB(Alpha=Slider(100, range=0..100), Red=0, Green=0, Blue=Slider(255, range=0..1000))
rgb_4 = ColourRGB(Alpha=Slider(100, range=0..100), Red=0, Green=0, Blue=Slider(255, range=0..1000))
rgb_5 = ColourRGB(Alpha=Slider(100, range=0..100), Red=0, Green=0, Blue=Slider(255, range=0..1000))
rgb_6 = ColourRGB(Alpha=Slider(100, range=0..100), Red=0, Green=0, Blue=Slider(255, range=0..1000))
preview = CustomPreview(Geometry=box, Material=rgb)
preview_2 = CustomPreview(Geometry=box_2, Material=rgb_2)
preview_3 = CustomPreview(Geometry=box_3, Material=rgb_3)
preview_4 = CustomPreview(Geometry=box_4, Material=rgb_4)
preview_5 = CustomPreview(Geometry=box_6, Material=rgb_5)
preview_6 = CustomPreview(Geometry=box_5, Material=rgb_6)

# ----
# Area 1
# Area 2
# Area 3
# Area 4
number_slider_2 = Slider(4.82, range=0..10)
number_slider_3 = Slider(11.48, range=0..100)
number_slider_4 = Slider(10.42, range=0..100)
number_slider_5 = Slider(5.57, range=0..10)
xz = XZPlane(Origin=Point(0, 0, 0))
xy = XYPlane(Origin=Point(0, 0, 0))
xy_2 = XYPlane(Origin=Point(0, 0, 0))
yz = YZPlane(Origin=Point(0, 0, 0))
dom = ConstructDomain(DomainStart=number_slider_4, DomainEnd=number_slider_3)
dom_2 = ConstructDomain(DomainStart=number_slider_2, DomainEnd=number_slider_5)
dom_3 = ConstructDomain(DomainStart=Slider(10.3, range=0..100), DomainEnd=Slider(11.55, range=0..100))
dom_4 = ConstructDomain(DomainStart=Slider(10.3, range=0..100), DomainEnd=Slider(11.55, range=0..100))
dom_5 = ConstructDomain(DomainStart=Slider(-9.25, range=-20..1), DomainEnd=Slider(-8.5, range=-20..1))
dom_6 = ConstructDomain(DomainStart=Slider(-8.4, range=-20..1), DomainEnd=Slider(-7.45, range=-20..1))
dom_7 = ConstructDomain(DomainStart=Slider(-7.34, range=-20..1), DomainEnd=Slider(-6.365, range=-20..1))
dom_8 = ConstructDomain(DomainStart=Slider(4.32, range=0..100), DomainEnd=Slider(5.57, range=0..100))
move = Move(Geometry=xz, Motion="0,-10.580,0")  # -> Geometry, Transform
move_2 = Move(Geometry=xy, Motion="0,0,3.76203")  # -> Geometry, Transform
move_3 = Move(Geometry=xy_2, Motion="0,0,3.76093")  # -> Geometry, Transform
move_4 = Move(Geometry=yz, Motion="9.866984,0,0")  # -> Geometry, Transform
planesrf = PlaneSurface(Plane=move.Geometry, XSize=dom, YSize=dom_2)
planesrf_2 = PlaneSurface(Plane=move_2.Geometry, XSize=dom_3, YSize=dom_5)
planesrf_3 = PlaneSurface(Plane=move_3.Geometry, XSize=dom_4, YSize=dom_6)
planesrf_4 = PlaneSurface(Plane=move_4.Geometry, XSize=dom_7, YSize=dom_8)

preview_7 = CustomPreview(
    Geometry=planesrf_3,
    Material={diffuse=RGB(221, 160, 221), emission=RGB(66, 48, 66), shine=0.5, specular=RGB(255, 255, 255), transparency=0})
preview_8 = CustomPreview(
    Geometry=planesrf_4,
    Material={diffuse=RGB(221, 160, 221), emission=RGB(66, 48, 66), shine=0.5, specular=RGB(255, 255, 255), transparency=0})
preview_9 = CustomPreview(
    Geometry=planesrf_2,
    Material={diffuse=RGB(221, 160, 221), emission=RGB(66, 48, 66), shine=0.5, specular=RGB(255, 255, 255), transparency=0})
preview_10 = CustomPreview(
    Geometry=planesrf,
    Material={diffuse=RGB(221, 160, 221), emission=RGB(66, 48, 66), shine=0.5, specular=RGB(255, 255, 255), transparency=0})

# ----
# Start
# Astronaut
number_slider_6 = Slider(0, range=-20..100)
pt_13 = ConstructPoint(XCoordinate=Slider(0, range=0..100), YCoordinate=number_slider_6, ZCoordinate=Slider(0, range=0..10))
pt_14 = ConstructPoint(XCoordinate=Slider(0, range=0..100), YCoordinate=Slider(0, range=-20..100), ZCoordinate=Slider(0, range=0..10))
pt_15 = ConstructPoint(XCoordinate=Slider(0.3, range=0..100), YCoordinate=Slider(0, range=-20..100), ZCoordinate=Slider(0, range=0..10))
pt_16 = ConstructPoint(XCoordinate=Slider(0, range=0..100), YCoordinate=Slider(-0.5, range=-20..100), ZCoordinate=Slider(0, range=0..10))
pt_17 = ConstructPoint(
    XCoordinate=Slider(9.815, range=0..100),
    YCoordinate=Slider(-9.806, range=-20..100),
    ZCoordinate=Slider(4.293, range=0..10))
pt_18 = ConstructPoint(XCoordinate=Slider(11.143, range=0..100), YCoordinate="-6.7607", ZCoordinate=Slider(4.965, range=0..10))
vec2pt = Vector2Pt(PointA=pt_13, PointB=pt_15, Unitize=False)  # -> Vector, Length
vec2pt_2 = Vector2Pt(PointA=pt_14, PointB=pt_16, Unitize=False)  # -> Vector, Length
cluster = Cluster(B=pt_17)
sph = Sphere(Base=pt_18, Radius=Slider(0.2, range=0..1))
sph_2 = Sphere(Base=pt_17, Radius=Slider(0.2, range=0..1))
vdisex = VectorDisplayEx(Point=pt_17, Vector=vec2pt.Vector, Colour=RGB(0, 0, 0), Width=2)
vdisex_2 = VectorDisplayEx(Point=pt_18, Vector=vec2pt_2.Vector, Colour=RGB(0, 0, 0), Width=2)
mesh = Mesh(sph)
faceb = FaceBoundaries(Mesh=cluster)
mesh_2 = Mesh(sph_2)
faceb_2 = FaceBoundaries(Mesh=mesh_2)
boundary = BoundarySurfaces(Edges=faceb_2)
join = BrepJoin(Breps=boundary)  # -> Breps, Closed
preview_11 = CustomPreview(
    Geometry=join.Breps,
    Material={diffuse=RGB(221, 160, 221), emission=RGB(66, 48, 66), shine=0.5, specular=RGB(255, 255, 255), transparency=0})

# ----
# Area 1
# Area 2
# Area 3
# Area 4
# Game flow
number_slider_7 = Slider(0.9, range=-2..2)
srf = Surface(planesrf_2)
# 流程演示
srf_2 = Surface(planesrf)
srf_3 = Surface(planesrf_3)
srf_4 = Surface(planesrf_4)
area = Area(Geometry=srf)  # -> Area, Centroid
area_2 = Area(Geometry=srf_2)  # -> Area, Centroid
area_3 = Area(Geometry=srf_3)  # -> Area, Centroid
Z = UnitZ(Factor=number_slider_7)
area_4 = Area(Geometry=srf_4)  # -> Area, Centroid
Z_2 = UnitZ(Factor=Slider(0.9, range=-2..2))
Y = UnitY(Factor=Slider(0.9, range=-2..2))
X = UnitX(Factor=Slider(0.9, range=-2..2))
mesh_3 = Mesh(cluster)
addition = Addition(A=area.Centroid, B=Z)
addition_2 = Addition(A=area_2.Centroid, B=Y)
addition_3 = Addition(A=area_3.Centroid, B=Z_2)
addition_4 = Addition(A=area_4.Centroid, B=X)
pt_19 = Point(pt_17)
pt_20 = Point(addition)
pt_21 = Point(addition_2)
pt_22 = Point(addition_3)
pt_23 = Point(addition_4)
pt_24 = Point(pt_18)
merge = Merge(Data1=pt_19, Data2=pt_21, Data3=pt_20, Data4=pt_22, Data5=pt_23, Data6=pt_24, Data7=pt_21)
pt_25 = Point(merge)
move2pt = MoveToPoint(Geometry=mesh_3, PointA=pt_19, PointB=pt_25)  # -> Moved, Vector, Transform
item = ListItem(List=move2pt.Moved, Index=Slider(6, range=0..7), Wrap=True)
faceb_3 = FaceBoundaries(Mesh=item)
preview_12 = CustomPreview(Geometry=faceb_3, Material=ColourSwatch(SwatchColor=RGB(137, 55, 191)))

faceb_4 = FaceBoundaries(Mesh=mesh)
boundary_2 = BoundarySurfaces(Edges=faceb_4)
join_2 = BrepJoin(Breps=boundary_2)  # -> Breps, Closed
preview_13 = CustomPreview(
    Geometry=join_2.Breps,
    Material={diffuse=RGB(221, 160, 221), emission=RGB(66, 48, 66), shine=0.5, specular=RGB(255, 255, 255), transparency=0})

# ----
# Airlock
number_slider_8 = Slider(0.5, range=0..1)
merge_2 = Merge(Data1=number_slider_2, Data2=number_slider_5)
merge_3 = Merge(Data1=number_slider_4, Data2=number_slider_3)
avr = Average(Input=merge_3)
avr_2 = Average(Input=merge_2)
cyl = Cylinder(Base=move.Geometry, Radius=number_slider_8, Length=Slider(1, range=0..10))
vec = VectorXYZ(XComponent=avr, YComponent=Slider(0, range=0..100), ZComponent=avr_2)  # -> Vector, Length
move_5 = Move(Geometry=cyl, Motion=vec.Vector)  # -> Geometry, Transform
mesh_4 = Mesh(move_5.Geometry)
faceb_5 = FaceBoundaries(Mesh=mesh_4)

mesh_5 = Mesh(cluster)
pt_26 = Point(pt_17)
faceb_6 = FaceBoundaries(Mesh=mesh_5)
pt_27 = Point("11.425,-9.5,4.9425")
pt_28 = Point(pt_17)
pt_29 = Point("11.425,-9.5,4.9425")
pt_30 = ConstructPoint(
    XCoordinate=Slider(11.425, range=0..100),
    YCoordinate=Slider(-9.5, range=-9.5..0),
    ZCoordinate=Slider(4.9425, range=0..10))
# Create point
pt_31 = Point("11.425,-9.5,4.9425")
cp = PlaneClosestPoint(Point=pt_29, Plane=planesrf)  # -> Point, UVPoint, Distance
# Measurement
dist = Distance(PointA=pt_28, PointB=pt_27)
# Translation
move2pt_2 = MoveToPoint(Geometry=faceb_6, PointA=pt_26, PointB=pt_31)  # -> Moved, Vector, Transform
move2pt_3 = MoveToPoint(Geometry=mesh_5, PointA=pt_26, PointB=pt_31)  # -> Moved, Vector, Transform
panel = Panel(pt_31)
preview_14 = CustomPreview(Geometry=move_5.Geometry, Material=ColourSwatch(SwatchColor=RGB(222, 211, 53)))
panel_2 = Panel(cp.Distance)
Z_3 = UnitZ(Factor=1)
pi = Pi(Factor=Slider(-0.5, range=-1..1))
# Rotation
cluster_2 = Cluster_2(mesh=move2pt_3.Moved, A=pi, B=Z_3)
faceb_7 = FaceBoundaries(Mesh=cluster_2)

# ----
# big box
number_slider_9 = Slider(5.961, range=0..10)
pt_32 = ConstructPoint(XCoordinate=Slider(12.441, range=0..100), YCoordinate=Slider(-11.3, range=-20..100), ZCoordinate=number_slider_9)
pt_33 = ConstructPoint(
    XCoordinate=Slider(8.393, range=0..100),
    YCoordinate=Slider(-5.3, range=-20..100),
    ZCoordinate=Slider(3.581, range=0..10))
box_7 = Box2Pt(PointA=pt_33, PointB=pt_32, Plane=PlaneXY(0, 0, 0))
number_slider_10 = Slider(255, range=0..1000)
rgb_7 = ColourRGB(Alpha=Slider(4, range=0..100), Red=number_slider_10, Green=number_slider_10, Blue=number_slider_10)

faceb_8 = FaceBoundaries(Mesh=box_7)

preview_15 = CustomPreview(Geometry=faceb_8, Material=rgb_7)

# ==== cluster Cluster
brep = Brep(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)
C = Center(Point(0, 0, 0))
scale = Scale(Geometry=brep, Center=C, Factor=Slider(0.003, range=0..1))  # -> Geometry, Transform
Y = UnitY(Factor=1)
number_slider = Slider(304, range=0..1000)
volume = Volume(Geometry=scale.Geometry)  # -> Volume, Centroid
move2pt = MoveToPoint(Geometry=scale.Geometry, PointA=volume.Centroid, PointB=C)  # -> Moved, Vector, Transform
xz = XZPlane(Origin=Point(0, 0, 0))
rotate = Rotate(Geometry=move2pt.Moved, Angle=-1.570796327, Plane=xz)  # -> Geometry, Transform
B = ClusterInput()
move2pt_2 = MoveToPoint(Geometry=rotate.Geometry, PointA=C, PointB=B)  # -> Moved, Vector, Transform
mesh = MeshBrep(
    Brep=move2pt_2.Moved,
    Settings={GridMaxCount=0, GridMinCount=16, JaggedSeams=False, MaxEdgeLength=0, MinEdgeLength=0.0001, MinTolerance=0, Refine=True, RefineAngle=0, RelativeTolerance=0.65, SimplePlanes=True, Tolerance=0})
M = ClusterOutput(mesh)

# ==== cluster Cluster_2
mesh = ClusterInput()
mesh_2 = Mesh(mesh)
B = ClusterInput()
volume = Volume(Geometry=mesh_2)  # -> Volume, Centroid
volume_2 = Volume(Geometry=mesh_2)  # -> Volume, Centroid
addition = Addition(A=volume.Centroid, B=B)
A = ClusterInput()
ln = Line(StartPoint=volume_2.Centroid, EndPoint=addition)
rotax = RotateAxis(Geometry=mesh_2, Angle=A, Axis=ln)  # -> Geometry, Transform
G = ClusterOutput(rotax.Geometry)
